# Grasshopper definition amberg.gh (Grasshopper 1.0.7)
# plug-ins: ElkGHComponents

panel = Panel("C:\Users\kouma\OneDrive\Documents\School Work\Session 5\Projet\finals\drawings\problem-goal\amberg.osm")
location = Location(FilePathText=panel)  # -> OSMPointData, OSMFile, LongitudeDomain, LatitudeDomain
osm_data = OSMData(
    OSMPointData=location.OSMPointData,
    OSMFilePath=location.OSMFile,
    Feature="highway",
    Generate3d=False,
    IndividualOutputs=False)  # -> Ways, FeatureKey
polyline = PolyLine(Vertices=osm_data.Ways, Closed=False)
